# Grasshopper definition model_multiple_shapes.gh (Grasshopper 1.0.7)
# plug-ins: SonicBranchCount, Human

panel = Panel("1.9375")
holes_diam = Panel("0.625")
# Brick dimensions
w = Panel("3.625")
l = Panel("7.625")
h = Panel("2.5")
search_or_deg_01 = Slider(0, range=0..90)
search_or_deg_02 = Slider(45, range=0..90)
search_or_deg_03 = Slider(45, range=0..90)
unit_rot_deg_01 = Slider(0, range=0..90)
unit_rot_deg_02 = Slider(45, range=0..90)
# ! if you want to keep one rotation value only set it to 0 !
unit_rot_deg_03 = Slider(90, range=0..90)
search_step = Slider(2, range=0..10)
max_num_courses = Slider(2, range=0..10)
min_area_overlap1 = Slider(20, range=0..100)
min_area_overlap2 = Slider(20, range=0..100)
pipeline = GeometryPipeline(
    GroupByLayer=False,
    GroupByType=False,
    IncludeHidden=True,
    IncludeLocked=True,
    LayerFilter="base_units",
    NameFilter="*",
    SublayerFiltering=True,
    TypeFilter=4)
merge = Merge(Data1=search_or_deg_01, Data2=search_or_deg_02)
merge_2 = Merge(Data1=unit_rot_deg_01, Data2=unit_rot_deg_03)

# ---- group: first course units
crv = Curve(pipeline)

# ---- group: search orientation
data = Data(merge)

# ---- group: unit rotation
data_2 = Data(merge_2)

# ---- group: search step dimension
search_step_2 = Data(search_step)

# ---- group: max num of courses
data_3 = Data(max_num_courses)

# ---- group: min overlap area 1 & 2
data_4 = Data(min_area_overlap1)
data_5 = Data(min_area_overlap2)

# ----
crv_2 = Curve([<curve referenced from the Rhino model> x4])
filer = FileHandlingInPython(py_fn="generative_stacking.py")  # -> py_fp
# ---------- filer: Python ----------
# FILE HANDLING IN GRASSHOPPER THROUGH PYTHON
# updated: 04/24/2018
import os

# get file path of current gh file
fp = ghenv.LocalScope.ghdoc.Path
print("current gh file path: {}".format(fp))

# get file directory and file name
(fd, fn) = os.path.split(fp)
print("file directory: {}".format(fd))
print("file name: {}".format(fn))
print("----")

py_fp = os.path.join(fd, "py_multiple_shapes", py_fn)
print(py_fp)
# ---------- end filer ----------
file = ReadFile(File=filer, PerLineParse=False)
python = GhPythonScript(
    Code=file,
    Geos_to_use=crv_2,
    Geos=crv,
    Rotation_degrees=data,
    Rotate_geo_degs=data_2,
    Search_step=search_step_2,
    Max_num_courses=data_3,
    Min_area_overlap1=data_4,
    Min_area_overlap2=data_5)  # -> Out, A, Placed_units, All_tests, Num_units_per_course, Overlapping_areas
bnd = Bounds(Numbers=python.Overlapping_areas)
panel_2 = Panel(filer)
python_2 = GhPythonScript(x=crv_2, geos=crv)  # -> out, a, b, c; inputs x: list, geos: list
# ---------- python_2: Python ----------
__author__ = "Lorenzo"
__version__ = "2019.04.08"

import rhinoscriptsyntax as rs
import Rhino.Geometry as rg
import scriptcontext as sc
sc.doc = ghdoc

a = []
b = []
c = []
def geo_translate(geo, vec, f=1):
    vec *= f
    xf = rg.Transform.Translation(vec)
    geo_id = sc.doc.Objects.Transform(geo, xf, False)
    return geo_id

for ig, avail_geo in enumerate(x):
    g1 = geos[ig] 
    g1_pt = rs.CurveAreaCentroid(g1)[0]
    c.append(g1_pt)
    vec = rs.VectorCreate(g1_pt, rs.CurveAreaCentroid(avail_geo)[0])
    b.append(vec)                            
    avail_geo = geo_translate(
            avail_geo, 
            vec)
    a.append(avail_geo)
# ---------- end python_2 ----------
dedomain = DeconstructDomain(Domain=bnd)  # -> Start, End
area = Area(Geometry=crv_2)  # -> Area, Centroid
geo = Geometry(python_2.c)
vdis = VectorDisplay(Anchor=area.Centroid, Vector=python_2.b)
gradient = Gradient(
    LowerLimit=dedomain.Start,
    UpperLimit=dedomain.End,
    Parameter=python.Overlapping_areas,
    stops=[0: RGB(234, 38, 0), 0.25: RGB(234, 126, 0), 0.5: RGB(254, 244, 84), 0.75: RGB(173, 203, 249), 1: RGB(75, 107, 169)])  # disabled
panel_3 = Panel(python.Out)
points = PointList(Points=area.Centroid, Size=1.5)
panel_4 = Panel(python.A)
crv_3 = Curve(python.All_tests)
partition = PartitionList(List=python.Placed_units, Size=python.Num_units_per_course)
number_slider = Slider(2.5, range=0..10)
bs = BranchCount(String=partition)
crv_4 = Curve(crv)
offset = OffsetCurve(Curve=crv_4, Distance=0.25, Plane=PlaneXY(0, 0, 0), Corners=1)
series = Series(Start=number_slider, Step=number_slider, Count=bs)
Z = UnitZ(Factor=series)
move = Move(Geometry=partition, Motion=graft(Z))  # -> Geometry, Transform
previewlw = CustomPreviewLineweights(Geometry=offset, Shader=ColourSwatch(SwatchColor=RGB(0, 0, 0)), Thickness=Slider(7, range=0..10), Absolute=False)
Z_2 = UnitZ(Factor=number_slider)
extr = Extrude(Base=crv_4, Direction=Z_2)
extr_2 = Extrude(Base=move.Geometry, Direction=Z_2)
cap = CapHoles(Brep=extr)
cap_2 = CapHoles(Brep=extr_2)
debrep = DeconstructBrep(Brep=cap_2)  # -> Faces, Edges, Vertices
join = JoinCurves(Curves=debrep.Edges, Preserve=False)
preview = CustomPreview(Geometry=cap, Material=ColourSwatch(SwatchColor=RGB(171, 101, 101)))
preview_2 = CustomPreview(Geometry=flatten(cap_2), Material=gradient)
preview_3 = CustomPreview(Geometry=cap_2, Material=ColourSwatch(SwatchColor=RGB(171, 101, 101)))
previewlw_2 = CustomPreviewLineweights(Geometry=join, Shader=ColourSwatch(SwatchColor=RGB(150, 150, 150)), Thickness=Slider(1, range=0..10), Absolute=False)
